# Dynamo graph Doraemon.dyn (Dynamo 4.1.2.5356)

number = DoubleInput(15)
number_2 = DoubleInput(5)
byCoordinates = Point.ByCoordinates(y=number, z=number_2)
number_3 = DoubleInput(17.5)
number_4 = DoubleInput(2.5)
byCoordinates_2 = Point.ByCoordinates(y=number_3, z=number_4)
byCoordinates_3 = Point.ByCoordinates(y=number)
byThreePoints = Circle.ByThreePoints(p1=byCoordinates, p2=byCoordinates_2, p3=byCoordinates_3)
number_5 = DoubleInput(360)
byRevolve = Solid.ByRevolve(profile=byThreePoints, sweepAngle=number_5)
integer_slider = IntegerSlider(26, range=0..100 step 1)
integer_slider_2 = IntegerSlider(25, range=0..100 step 1)
byCoordinates_4 = Point.ByCoordinates(x=integer_slider, z=integer_slider_2)
number_6 = DoubleInput(2)
byCenterPointRadius = Sphere.ByCenterPointRadius(centerPoint=byCoordinates_4, radius=number_6)
number_7 = DoubleInput(21.4)
byCoordinates_5 = Point.ByCoordinates(x=number_7)
number_8 = DoubleInput(21.7)
number_9 = DoubleInput(0.6)
byCoordinates_6 = Point.ByCoordinates(x=number_8, z=number_9)
number_10 = DoubleInput(22)
byCoordinates_7 = Point.ByCoordinates(x=number_10)
byThreePoints_2 = Circle.ByThreePoints(p1=byCoordinates_5, p2=byCoordinates_6, p3=byCoordinates_7)
integer_slider_3 = IntegerSlider(19, range=0..100 step 1)
number_11 = DoubleInput(-1)
byCoordinates_8 = Point.ByCoordinates(x=integer_slider_3, z=number_11)
number_12 = DoubleInput(360)
byRevolve_2 = Solid.ByRevolve(profile=byThreePoints_2, axisOrigin=byCoordinates_8, sweepAngle=number_12)
number_13 = DoubleInput(3)
byCenterPointRadius_2 = Sphere.ByCenterPointRadius(centerPoint=byCoordinates_8, radius=number_13)
number_14 = DoubleInput(16)
number_15 = DoubleInput(-1)
byOrigin = CoordinateSystem.ByOrigin(x=number_14, z=number_15)
number_16 = DoubleInput(0.8)
number_17 = DoubleInput(6)
byRadiusHeight = Cylinder.ByRadiusHeight(coordinateSystem=byOrigin, radius=number_16, height=number_17)
number_18 = DoubleInput(16)
number_19 = DoubleInput(-1)
byCoordinates_9 = Point.ByCoordinates(x=number_18, z=number_19)
YAxis = Vector.YAxis()
number_20 = DoubleInput(90)
rotate = Geometry.Rotate(geometry=byRadiusHeight, origin=byCoordinates_9, axis=YAxis, degrees=number_20)
number_21 = DoubleInput(16)
number_22 = DoubleInput(-0.3)
number_23 = DoubleInput(-4)
byCoordinates_10 = Point.ByCoordinates(x=number_21, y=number_22, z=number_23)
number_24 = DoubleInput(22)
number_25 = DoubleInput(0.3)
number_26 = DoubleInput(-0.5)
byCoordinates_11 = Point.ByCoordinates(x=number_24, y=number_25, z=number_26)
byCorners = Cuboid.ByCorners(lowPoint=byCoordinates_10, highPoint=byCoordinates_11)
list_create = List.Create(item0=rotate, item1=byCorners)
byUnion = Solid.ByUnion(solids=list_create)
difference = Solid.Difference(solid=byCenterPointRadius_2, other=byUnion)
list_create_2 = List.Create(item0=byRevolve_2, item1=difference)
byUnion_2 = Solid.ByUnion(solids=list_create_2)
number_27 = DoubleInput(25)
byCoordinates_12 = Point.ByCoordinates(z=number_27)
number_28 = DoubleInput(25)
byCenterPointRadius_3 = Sphere.ByCenterPointRadius(centerPoint=byCoordinates_12, radius=number_28)
number_29 = DoubleInput(1.05)
number_30 = DoubleInput(1.05)
scale = Geometry.Scale(geometry=byCenterPointRadius_3, yamount=number_29, zamount=number_30)
number_31 = DoubleInput(-1.3)
translate = Geometry.Translate(geometry=scale, xTranslation=number_31)
difference_2 = Solid.Difference(solid=translate, other=byCenterPointRadius_3)
number_32 = DoubleInput(25)
number_33 = DoubleInput(5)
number_34 = DoubleInput(27)
byCoordinates_13 = Point.ByCoordinates(x=number_32, y=number_33, z=number_34)
number_35 = DoubleInput(25)
number_36 = DoubleInput(15)
number_37 = DoubleInput(30)
byCoordinates_14 = Point.ByCoordinates(x=number_35, y=number_36, z=number_37)
byStartPointEndPoint = Line.ByStartPointEndPoint(startPoint=byCoordinates_13, endPoint=byCoordinates_14)
number_38 = DoubleInput(25)
number_39 = DoubleInput(5)
number_40 = DoubleInput(25)
byCoordinates_15 = Point.ByCoordinates(x=number_38, y=number_39, z=number_40)
number_41 = DoubleInput(25)
number_42 = DoubleInput(15)
number_43 = DoubleInput(25)
byCoordinates_16 = Point.ByCoordinates(x=number_41, y=number_42, z=number_43)
byStartPointEndPoint_2 = Line.ByStartPointEndPoint(startPoint=byCoordinates_15, endPoint=byCoordinates_16)
number_44 = DoubleInput(25)
number_45 = DoubleInput(5)
number_46 = DoubleInput(23)
byCoordinates_17 = Point.ByCoordinates(x=number_44, y=number_45, z=number_46)
number_47 = DoubleInput(25)
number_48 = DoubleInput(15)
number_49 = DoubleInput(20)
byCoordinates_18 = Point.ByCoordinates(x=number_47, y=number_48, z=number_49)
byStartPointEndPoint_3 = Line.ByStartPointEndPoint(startPoint=byCoordinates_17, endPoint=byCoordinates_18)
list_create_3 = List.Create(item0=byStartPointEndPoint, item1=byStartPointEndPoint_2, item2=byStartPointEndPoint_3)
integer_slider_4 = IntegerSlider(45, range=0..100 step 1)
integer_slider_5 = IntegerSlider(7, range=0..100 step 1)
integer_slider_6 = IntegerSlider(37, range=0..100 step 1)
byCoordinates_19 = Point.ByCoordinates(x=integer_slider_4, y=integer_slider_5, z=integer_slider_6)
number_50 = DoubleInput(8)
byCenterPointRadius_4 = Sphere.ByCenterPointRadius(centerPoint=byCoordinates_19, radius=number_50)
number_51 = DoubleInput(0.5)
number_52 = DoubleInput(0.8)
scale_2 = Geometry.Scale(geometry=byCenterPointRadius_4, xamount=number_51, yamount=number_52)
integer_slider_7 = IntegerSlider(24, range=0..100 step 1)
integer_slider_8 = IntegerSlider(5, range=0..100 step 1)
integer_slider_9 = IntegerSlider(37, range=0..100 step 1)
byCoordinates_20 = Point.ByCoordinates(x=integer_slider_7, y=integer_slider_8, z=integer_slider_9)
number_53 = DoubleInput(3)
byCenterPointRadius_5 = Sphere.ByCenterPointRadius(centerPoint=byCoordinates_20, radius=number_53)
list_create_4 = List.Create(item0=scale_2, item1=byCenterPointRadius_5)
byUnion_3 = Solid.ByUnion(solids=list_create_4)
integer_slider_10 = IntegerSlider(12, range=0..100 step 1)
integer_slider_11 = IntegerSlider(1, range=0..100 step 1)
integer_slider_12 = IntegerSlider(15, range=0..100 step 1)
byCoordinates_21 = Point.ByCoordinates(x=integer_slider_10, y=integer_slider_11, z=integer_slider_12)
number_54 = DoubleInput(7)
byCenterPointRadius_6 = Sphere.ByCenterPointRadius(centerPoint=byCoordinates_21, radius=number_54)
number_55 = DoubleInput(1.2)
number_56 = DoubleInput(0.7)
scale_3 = Geometry.Scale(geometry=byCenterPointRadius_6, yamount=number_55, zamount=number_56)
list_create_5 = List.Create(item0=list_create_3, item1=byUnion_3, item2=scale_3)
XZ = Plane.XZ()
mirror = Geometry.Mirror(geometry=list_create_5, mirrorPlane=XZ)
number_57 = DoubleInput(24.8)
number_58 = DoubleInput(21)
number_59 = DoubleInput(19)
byCoordinates_22 = Point.ByCoordinates(x=number_57, y=number_58, z=number_59)
number_60 = DoubleInput(24.8)
number_61 = DoubleInput(5)
byCoordinates_23 = Point.ByCoordinates(x=number_60, z=number_61)
number_62 = DoubleInput(24.8)
number_63 = DoubleInput(-21)
number_64 = DoubleInput(19)
byCoordinates_24 = Point.ByCoordinates(x=number_62, y=number_63, z=number_64)
byThreePoints_3 = Arc.ByThreePoints(firstPoint=byCoordinates_22, secondPoint=byCoordinates_23, thirdPoint=byCoordinates_24)
byStartPointEndPoint_4 = Line.ByStartPointEndPoint(startPoint=byCoordinates_22, endPoint=byCoordinates_24)
join = Curve.Join(curve=byThreePoints_3, curves=byStartPointEndPoint_4)
YAxis_2 = Vector.YAxis()
number_65 = DoubleInput(90)
byRevolve_3 = Solid.ByRevolve(profile=join, axisOrigin=byCoordinates_22, axisDirection=YAxis_2, sweepAngle=number_65)
difference_3 = Solid.Difference(solid=byCenterPointRadius_3, other=byRevolve_3)
